# Grasshopper definition homework1.gh (Grasshopper 1.0.8)

circle = Circle(Plane=PlaneXY(0, 0, 0), Radius=Slider(5, range=0..10))
get_geometry = GetGeometry(circle, AnnotationTypeFilter=3966, AtLeast=1, AtMost=1, DeleteInput=False, Filter=1074081855, TreeAccess=False)
offset_curve = OffsetCurve(Curve=get_geometry, Distance=Slider(5, range=0..10), Corners=1)
unit_z = UnitZ(Factor=Slider(4, range=0..10))
move = Move(Geometry=offset_curve, Motion=unit_z)  # -> Geometry, Transform
number_slider = Slider(10, range=0..10)
surface = Surface([move.Geometry, get_geometry])
series = Series(Start=number_slider, Step=number_slider, Count=10)
unit_z_2 = UnitZ(Factor=series)
move_2 = Move(Geometry=surface, Motion=unit_z_2)  # -> Geometry, Transform
context_bake = ContextBake(Content=move_2.Geometry)
